# Dynamo graph ChangeSysPath.dyn (Dynamo 2.0.3.8810)

string = StringInput("ChangeSysPath.py")  # graph input
file_from_path = FileObject(path=string)
readText = FileSystem.ReadText(file=file_from_path)
boolean = BoolSelector(false)
el_sys_id = CodeBlock { 569579; }
cable_tray_code = StringInput("test")
python_script_from_string = PythonStringNode(script=readText, IN[0]=file_from_path, IN[1]=boolean, IN[2]=el_sys_id, IN[3]=cable_tray_code)
python_script = Python(IN[0]=boolean)
# ---------- python_script.python (35 lines) ----------
import itertools
import operator


def flatten_list(data):
	# iterating over the data
	list_in_progress = data
	outlist = list()
	
	list_found = True
	n = 0
	#while any(lists_found)
	while list_found:
		flat_list = list()
		list_found = False
		for i in list_in_progress:
			if isinstance(i, list):
				list_found = True
				map(lambda x: flat_list.append(x), i)		
			else:
				flat_list.append(i)
				
		list_in_progress = [x for x in flat_list]
		outlist.append(list_in_progress)
	return outlist
				
			
       

outlist = list()
tl = [1, [2,3], [[4,[5]],6]]
oneLvl = [[1,2],[3],[4]]

	
OUT = flatten_list(tl)
# ----------------------------------------
