# Dynamo graph path_is_custom.dyn (Dynamo 2.13.1.3887)

string = StringInput("path_is_custom.py")  # graph input
file_from_path = FileObject(path=string)
readText = FileSystem.ReadText(file=file_from_path)

# group: Reload
# Reload
reload = BoolSelector(false)

# group: CSV
# Results to save in csv
switch_settings = StringInput("electrical_systems_to_check.csv")  # graph input

python_script_from_string = PythonStringNode(script=readText, IN[0]=file_from_path, IN[1]=reload, IN[2]=switch_settings)  # CPython3
